# Grasshopper definition PATREON_MEMBERSHIP_ONLY_Rhino7_GHPYTHON_WickersonStudios_BACK_TO_THE_BASICS_(GhPython_Component)_001.gh (Grasshopper 1.0.7)
# Copyright: bernhard muller bijoutiers
# plug-ins: Workshop, Bifocals

# https://github.com/mwickerson/PATREON_MEMBERS_ONLY_ghpythonNodeBasics
# gitHub: Mwickerson
# POINT
wickerson_s_first_grasshopper_component = WickersonsFirstGrasshopperComponent()  # disabled
gene_pool = GenePool(Decimals=0, Maximum=100, Minimum=0, Value=[17.71896417, 28, 38.96894243, 41, 52, 55])
construct_point = ConstructPoint(XCoordinate=0, YCoordinate=0, ZCoordinate=0)
explode_tree = ExplodeTree(Data=graft(gene_pool))  # -> Branch0, Branch1, Branch2, Branch3, Branch4, Branch5
ghpython_script = GhPythonScript(
    x=gene_pool,
    y=explode_tree.Branch1,
    z=explode_tree.Branch2,
    p=explode_tree.Branch3,
    q=explode_tree.Branch4,
    r=explode_tree.Branch5)  # -> out, pointA_out, pointB_out; inputs x: Int32, y: Int32, z: Int32, p: Int32, q: Int32, r: Int32
# ---------- ghpython_script: Python ----------
import rhinoscriptsyntax as rs
import Rhino.Geometry as rg

pointA = rg.Point3d(x,y,z)
pointB = rs.AddPoint(p,q,r)

pointA_out = pointA
pointB_out = pointB
# ---------- end ghpython_script ----------
circle_3pt = Circle3Pt(PointA=ghpython_script.pointA_out, PointB=construct_point, PointC=ghpython_script.pointB_out)  # -> Circle, Plane, Radius
loft = Loft(
    Curves=circle_3pt.Circle,
    Options={Adjust=False, Closed=False, LoftEnds=0, LoftSimp=0, LoftType=0, Rebuild=10, Refit=0.01})
